# Dynamo graph SPACE PLAN EXAMPLE.dyn (Dynamo 1.1.0.2093)

# note: Intended site coverage in percentage. Value should be between 0 to 1. For example 0.3 means 30% site coverage, meaning Building Outline Area should be 30% of the site area.
# note: FormBuildingOutline node computes site coverage from the program document. But user can over ride that by providing a site coverage as an input.
siteCoverage = DoubleSlider(0.9, range=0.25..0.9 step 0.05)
accceptablePolyGridDim = DoubleSlider(13.8, range=5..100 step 0.1)
string_siteoutline = StringInput("C:\Users\subha\Documents\Visual Studio 2015\Projects\SPG DYNS\TESTEDCASESTUDIES\SFDUG CASE BED T\hospSite4.sat")
# note: Please provide a file path address of a ".sat" file representing site outline.
# note: Site inset value provides site set back value for each side of the site.
site_inset = DoubleSlider(6, range=1..25 step 1)
# note: Cell dimension provideds the length and width of the cell grid. Lower value enables higher precision while computing spatial assignment.
cell_dim = DoubleSlider(4.1, range=1..25 step 0.1)
# note: Design seed represents direct mapping of each space plan to a number. Slide to generate new space plan for same input parameters.
designseed_for_buildingoutline = IntegerSlider(695, range=2..1000 step 1)
# note: High Precision set to true allows as many as 2500 cells to compute space plan. If set to false, maximum cells allowed is limited to 1000. Higher precision set to true, will slow down computation, but computation would be more precise.
boolean_highprecision = BoolSelector(false)
string = StringInput("C:\Users\subha\Documents\Visual Studio 2015\Projects\SPG DYNS\TESTEDCASESTUDIES\NEW PROGRAMS\bedTowerShort.csv")
circulation_add_on_factor = DoubleSlider(1.5, range=0.5..2 step 0.05)
# note: StackOptionsDept boolean set to true, allows varied department placement on the same building form outline. The Department stacking options can be seen on change of Design Seed (for Dept) input parameter.
boolean_stackoptionsdept = BoolSelector(false)
# note: StackOptionsProg boolean set to true, allows varied program placement on the same building form outline and same department placement. The Program stacking options can be seen on change of Design Seed (for Program) input parameter.
boolean_stackoptionsprog = BoolSelector(true)
makeDataStack = SpacePlanning.ReadData.MakeDataStack(string, circulation_add_on_factor, boolean_stackoptionsdept, boolean_stackoptionsprog)

# group: ATTRACTORS
number_slider = DoubleSlider(-89.8, range=-500..500 step 0.1)
number_slider_2 = DoubleSlider(115.6, range=-500..500 step 0.1)
code_block = CodeBlock(x=number_slider, y=number_slider_2) { Point2d.ByCoordinates(x,y); }
number_slider_3 = DoubleSlider(102.8, range=-500..500 step 0.1)
number_slider_4 = DoubleSlider(-25, range=-500..500 step 0.1)
code_block_2 = CodeBlock(x=number_slider_3, y=number_slider_4) { Point2d.ByCoordinates(x,y); }
create = List.Create(code_block, code_block_2)
number_slider_5 = DoubleSlider(11.8, range=1..200 step 0.1)
number_slider_6 = DoubleSlider(2, range=1..200 step 0.1)
create_2 = List.Create(number_slider_5, number_slider_6)
pointByPoint2d = stuffer.DynamoGeometry.PointByPoint2d(code_block)
code_block_3 = CodeBlock { 30; }
circleByRadius = SpacePlanning.PolygonUtility.CircleByRadius(create, create_2, code_block_3)
polygonByPolygon2d = stuffer.DynamoGeometry.PolygonByPolygon2d(circleByRadius)
pointByPoint2d_2 = stuffer.DynamoGeometry.PointByPoint2d(code_block_2)

# note: If RemoveNotch is set to true, then while computing the Building Outline, the system will remove any sides from the outline less than an input threshold distance. That input is, "minNotchDistance".
boolean_remove_notch = BoolSelector(true)
# note: The minNotchDistance removes small offsets/ notches from the building outline. Toggle the value to refine the form of the building.
minNotchDistance = DoubleSlider(14.7, range=10..40 step 0.1)
number_slider_7 = DoubleSlider(-7.8, range=-500..500 step 0.1)
number_slider_8 = DoubleSlider(289.2, range=-500..500 step 0.1)
code_block_4 = CodeBlock(x=number_slider_7, y=number_slider_8) { Point2d.ByCoordinates(x,y); }
# note: Depth of the Kpu Department. It is input as list to account for more than one Kpu Department in the program document.
kpu_depth1 = DoubleSlider(30, range=12..45 step 0.5)
kpu_depth2 = DoubleSlider(23.5, range=12..45 step 0.5)
create_3 = List.Create(kpu_depth1, kpu_depth2)
# note: SpacePlan generation is based on the concept of splitting polygons recursively and allocating them to respective department or program. Polysubdivision controls the number of vertices a Polygon has before splitting. Lower value represents higher vertex count per polygon and makes computation precise but slower.
polySubdivision = DoubleSlider(10, range=1..50 step 0.1)
# note: Design seed represents direct mapping of each space plan to a number. Slide to generate new space plan for same input parameter and BuildingOutline.
designSeedForDepartment = DoubleSlider(406, range=2..1000 step 1)
# note: NoExternalWall if set to true, will make the placement of KPU Dept, without caring for an external wall.
boolean_no_external_wall = BoolSelector(true)
# note: UnlimitedKPU if set to true, will try to place as much KPU programs in the spaceplan, overshooting its area requirements from the program document.
boolean_unlimitedkpu = BoolSelector(false)
boolean_mode3d = BoolSelector(false)
# note: When Mode3D is set to true, total building height input is used to set number of floors and building height.
totalbuilding_height = DoubleSlider(45, range=0..500 step 0.1)
# note: Average floor height value represents floor height of every floor.
avgFloorHeight = DoubleSlider(10, range=9..18 step 0.5)
# note: When Mode3D is set to true, NumDeptPerFloor controls placement of maximum number of department per floor.
numDeptPerFloor = DoubleSlider(2, range=1..4 step 1)
# note: HighIterationDepartment set to true, allows computing department allocation with higher precision and allows multiple checks to be performed while allocating departments. Set to true, slows down computation.
boolean_highiterationdepartment = BoolSelector(false)
# note: Width of the Kpu Department. It is input as list to account for more than one Kpu Department in the program document.
kpu_width1 = DoubleSlider(12, range=4..25 step 0.5)
kpu_width2 = DoubleSlider(16, range=10..25 step 0.5)
create_4 = List.Create(kpu_width1, kpu_width2)
# note: Min allowed dimension of a polygon ( length or width ) to be acceptable to be assigned to any program space.
minAllowedDimension = DoubleSlider(4, range=1..20 step 0.1)
# note: Design seed represents direct mapping of each space plan to a number. Slide to generate new space plan for same input parameter, BuildingOutline and Department Polygons.
designSeedForProgram = DoubleSlider(757, range=2..1000 step 1)
# note: CheckAspectRatio if set to true, will check the program polygons for acceptable aspect ratio ( length/width ) and will discard any which does not meet the requirement.
boolean_checkaspectratio = BoolSelector(false)
# note: Z Axis value for visualization of surfaces representing program spaces.
heightPolylinesRegSpaces = DoubleSlider(0.1, range=-10..100 step 0.1)
# note: Input selects the color scheme for visualizing space plan programs.
colorSchemeSpacePlan = IntegerSlider(15, range=0..100 step 1)
# note: ColorProgramSeparate set to true, visualizes each program space with an unique color. Set to false, each department programs are visualized with one color.
boolean_colorprogramseparate = BoolSelector(false)
# note: Opacity of the colors for visualization.
opacity = DoubleSlider(5, range=0..100 step 1)
# note: Z Axis value for visualization of Program polygons and Program texts.
textPolyLinesKPULinesHeight = DoubleSlider(0.2, range=0..10 step 0.1)
# note: FullProgramNames, when set to true, allows visualization of full program names. Set to false, visualizes abbreviated program names ( short form ).
boolean_fullprogramnames = BoolSelector(false)
# note: Scale value for the text visualization representing program names on the space plan.
textScale = DoubleSlider(1, range=0.3..2 step 0.1)
# note: Rotation angle for the text visualization representing program names on the space plan.
textRotationAngle = DoubleSlider(37.6, range=0..100 step 0.1)
# note: Z Axis value for visualization of circulation in the space plan.
circulationHeight = DoubleSlider(0.1, range=0..5 step 0.1)
# note: User weight for one of the space plan evaluation metric - Program Fitness on Site. Value should be between 0-1.
programFitWeight = DoubleSlider(0.9, range=0.1..1 step 0.1)
# note: User weight for one of the space plan evaluation metric - External View of KPU. Value should be between 0-1.
extViewWeight = DoubleSlider(1, range=0.1..1 step 0.1)
# note: User weight for one of the space plan evaluation metric - Travel distance from a support space to the KPU's. Value should be between 0-1.
travDistWeight = DoubleSlider(0.9, range=0.1..1 step 0.1)
percKPUWeight = DoubleSlider(0.9, range=0.1..1 step 0.1)
# note: Please copy-paste your program document string from a.csv file into a string node and connect to MakeDataStackFromString node's programDocumentString input.
# note: Circulation add on factor is multipled with the area requirement from the provided program document, to account for the area needed for circulation spaces. Minimum value should be 1. Any value above than 1 would ensure surpluss area alotted to circulation spaces.
string_programdocument = StringInput("""PROGRAM ID,PROGRAM NAME,ZONE/ DEPARTMENT,QUANTITY,AREA,TOTAL AREA,PREFERENCE VALUE,PROGRAM TYPE,ADJACENT PROGRAMS,DEPT ID,ADJACENT DEPT
0,Patient Visitor Lounge Waiting Area,PSYCHIATRIC INPATIENT,10,20,200,6,REG,4,0,1.3.4
1,Alcove Telephone,PSYCHIATRIC INPATIENT,1,10,10,10,REG,0,0,
2,Alcove Vending Machine,PSYCHIATRIC INPATIENT,1,20,20,10,REG,0,0,
3,Toilet Male Female,PSYCHIATRIC INPATIENT,1,60,60,5,REG,0,0,
4,Workstation Reception,PSYCHIATRIC INPATIENT,1,40,40,2,REG,0.6,0,
5,Lockers Visitors,PSYCHIATRIC INPATIENT,10,0,0,7,REG,4,0,
6,Entrance Vestibule,PSYCHIATRIC INPATIENT,1,100,100,3,REG,4.7.8,0,
7,Interview Exam Room,EXAM ROOM ,15,100,1500,1,KPU,6.8,1,0.2.3
8,Workstation Care Team,EXAM ROOM ,8,30,240,1,KPU,6.7,1,
9,Office Touchdown,PSYCHIATRIC INPATIENT,3,30,90,5,REG,10.11,0,
10,Work area Huddle,PSYCHIATRIC INPATIENT,1,80,80,6,REG,9.11.12.13,0,
11,Workstation Staff,PSYCHIATRIC INPATIENT,1,100,100,3,REG,8.13.11,0,
12,Office Private First Line Leader,PSYCHIATRIC INPATIENT,1,100,100,7,REG,13.11,0,
13,Business Centre,PSYCHIATRIC INPATIENT,1,60,60,9,REG,9.10.11,0,
14,RID intentionally left blank,PSYCHIATRIC INPATIENT,0,0,0,0,REG,0,0,
15,Storage Patient Belongings Secured,PSYCHIATRIC INPATIENT,15,10,150,7,REG,8,0,
16,Medication Room,PSYCHIATRIC INPATIENT,1,120,120,4,REG,8,0,
17,Equipment Storage,PSYCHIATRIC INPATIENT,1,150,150,8,REG,18.1,0,
18,Storage Bed & Mattress,PSYCHIATRIC INPATIENT,2,20,40,8,REG,17.1,0,
19,Storage Equipment,PSYCHIATRIC INPATIENT,4,20,80,8,REG,17.18,0,
20,Patient Education Room,KPU PSY INPATIENT,1,120,120,2,KPU,21.8.22,2,0.1.5
21,Patient Education Room,KPU PSY INPATIENT,1,120,120,2,KPU,20.8.22,2,
22,Workstation Observation ,WORKSTATION ,1,30,30,3,KPU,20.21,3,0.1.2.4
23,Family Education Counselling Room,WORKSTATION ,1,240,240,4,KPU,8,3,
24,Group ActivitiesActivation Room Noisy Activities,WORKSTATION ,1,320,320,2,KPU,25.27,3,
25,Exercise Room,WORKSTATION ,1,150,150,4,KPU,24.26,3,
26,Equipment Storage PT OT,PSYCHIATRIC INPATIENT,1,60,60,8,REG,28,0,
27,On Floor Food Service Galley,PSYCHIATRIC INPATIENT,1,180,180,3,REG,6.24,0,
28,Utility Room Clean,PSYCHIATRIC INPATIENT,1,100,100,6,REG,29,0,
29,Utility Room Soiled,PSYCHIATRIC INPATIENT,1,100,100,6,REG,28,0,
30,Laundry Personal Clothing,PSYCHIATRIC INPATIENT,1,40,40,7,REG,31,0,
31,Housekeeping Room,PSYCHIATRIC INPATIENT,1,60,60,7,REG,30,0,
32,Staff Lounge Break Room,PSYCHIATRIC INPATIENT,1,180,180,4,REG,33,0,
33,Toilet MaleFemale Staff,PSYCHIATRIC INPATIENT,1,60,60,5,REG,34.32,0,
34,Office Unassigned,PSYCHIATRIC INPATIENT,1,100,100,8,REG,32,0,
35,Patient Room Private,KPU PSY INPATIENT,11,200,2200,1,KPU,8.37.36,2,
36,Vestibule Anteroom,MISC ,1,60,60,1,KPU,35,4,0.2.6
37,Toilet Patient,MISC ,11,60,660,2,KPU,35,4,
38,Seclusion Room,KPU PSY INPATIENT,2,120,240,1,KPU,39.6.8,2,
39,Secured Re-Integration  Multipurpose Area,MISC ,25,10,250,3,KPU,38.4,4,
40,Patient Room Seclusion,KPU PSY INPATIENT,20,40,800,1,KPU,39.8,2,
41,Shower Room,PSYCHIATRIC INPATIENT,7,10,70,3,REG,40,0,
42,Walk-in Vestibule,MHSU EMERGENCY,6,10,60,2,REG,43.42,5,1.3.6.7
43,Waiting Room Patients,MHSU EMERGENCY,10,10,100,4,REG,42.44.45,5,
44,Care Station  Reception,MHSU EMERGENCY,26,10,260,2,REG,43.44.46.47.48.50.53.54,5,
45,Interview Assessment Room,MHSU EMERGENCY,11,40,440,1,REG,42.43.44,5,
46,Cubicle Recliner Chairs,MHSU EMERGENCY,8,60,480,1,REG,44.47,5,
47,Stretcher Bay,MHSU EMERGENCY,12,20,240,1,REG,44.46,5,
48,Seclusion Room,MHSU EMERGENCY,14,40,560,1,REG,46.42.49,5,
49,Anteroom Seclusion Room,MHSU EMERGENCY,5.5,10,55,1,REG,48,5,
50,Shower Patient Wheelchair,MHSU EMERGENCY,4.6,10,46,3,REG,51,5,
51,Washroom Patient Wheelchair,MHSU EMERGENCY,4.6,10,46,7,REG,50,5,
52,Team Room,MHSU EMERGENCY,12,10,120,6,REG,44,5,
53,Medication Room,MHSU EMERGENCY,7,10,70,5,REG,44,5,
54,Alcove Clean Linen Supply,MHSU EMERGENCY,3,10,30,10,REG,46.47,5,
55,Alcove Soiled Linen Supply,MHSU EMERGENCY,3,10,30,10,REG,49,5,
56,Alcove Food Services,MHSU EMERGENCY,3,10,30,9,REG,44,5,
57,Waiting Room,REGISTRATION,22.5,10,225,6,REG,58.57.59,6,
58,Self-registration Kiosk,REGISTRATION,1,30,30,3,REG,57,6,
59,Registration Counter,REGISTRATION,6,40,240,2,REG,58.67.60.61.62.63,6,
60,Office Supervisor,REGISTRATION,9,10,90,7,REG,59.61,6,
61,Staff Coat Closet,REGISTRATION,2.5,10,25,10,REG,59.60.62.63,6,
62,Alcove Print and Recycling,REGISTRATION,4,10,40,9,REG,59.63,6,
63,Alcove Emergency Storage,REGISTRATION,1.5,10,15,5,REG,59.62,6,
64,Entrance Vestibule,PUBLIC SUPPORT,5.6,10,56,6,REG,65.66,7,4.5
65,Wheelchair Alcove,PUBLIC SUPPORT,2.8,10,28,9,REG,64.66,7,
66,Workstation Information Greeter,PUBLIC SUPPORT,4.5,10,45,10,REG,64,7,
67,Lobby,PUBLIC SUPPORT,30,10,300,2,REG,64.74.59.58,7,
68,ATM Alcove,PUBLIC SUPPORT,1,10,10,10,REG,67,7,
69,Telephone Alcove,PUBLIC SUPPORT,1,10,10,10,REG,67,7,
70,Toilet Male,PUBLIC SUPPORT,9.8,10,98,6,REG,67.71,7,
71,Toilet Female,PUBLIC SUPPORT,10.4,10,104,6,REG,67.71,7,
72,Cafeteria Servery Bistro,PUBLIC SUPPORT,25,10,250,3,REG,73,7,
73,Cafeteria Support Kitchen,PUBLIC SUPPORT,12,10,120,3,REG,72,7,
74,Meditation Garden,PUBLIC SUPPORT,50,10,500,2,REG,67,7,""")

# group: DATA STACK
code_block_5 = CodeBlock(siteOutline=string_siteoutline) { siteOutline; }
getSiteOutlineFromSat = SpacePlanning.ReadData.GetSiteOutlineFromSat(code_block_5)
convertSiteOutlineToPolygon2d = SpacePlanning.ReadData.ConvertSiteOutlineToPolygon2d(getSiteOutlineFromSat, site_inset)
code_block_6 = CodeBlock(progDocString=string_programdocument) { progDocString; }
makeDataStackFromString = SpacePlanning.ReadData.MakeDataStackFromString(circulation_add_on_factor, code_block_6, boolean_stackoptionsdept, boolean_stackoptionsprog)

# group: BUILDING FORM
findOrthoSiteOutline = SpacePlanning.GridObject.FindOrthoSiteOutline(convertSiteOutlineToPolygon2d, cell_dim, designseed_for_buildingoutline, boolean_highprecision)
# note: Z axis value of all the visualized geometry, i.e. Polygons, Surfaces etc.
heights = CodeBlock { cirHtP = 1.25; ht2 = -0.1; {}; 150; }
makeCellPolysFromCellObjects = SpacePlanning.GridObject.MakeCellPolysFromCellObjects(findOrthoSiteOutline.out3, heights.out2, heights.ht2)
byARGB = Color.ByARGB(a=heights.out3, r=heights.out3, g=heights.out3, b=heights.out3)
byGeometryColor = Display.Display.ByGeometryColor(makeCellPolysFromCellObjects, byARGB)

formBuildingOutline = SpacePlanning.GridObject.FormBuildingOutline(findOrthoSiteOutline.out0, findOrthoSiteOutline.out3, makeDataStack, create, create_2, arg6=designseed_for_buildingoutline, arg7=boolean_remove_notch, arg8=minNotchDistance)

# group (continued): BUILDING FORM
code_block_7 = CodeBlock(buildOutline=formBuildingOutline.out0) { buildOutline; }
site_area = Watch(formBuildingOutline.out1)
site_coverage_achieved = Watch(formBuildingOutline.out5)
polygonByPolygon2d_2 = stuffer.DynamoGeometry.PolygonByPolygon2d(formBuildingOutline.out0, heights.cirHtP)

# group: DEPT & PROGRAM PLACEMENT
placeDepartments = SpacePlanning.BuildLayout.PlaceDepartments(makeDataStack, code_block_7, code_block_4, create_3, polySubdivision, designSeedForDepartment, boolean_no_external_wall, boolean_unlimitedkpu, boolean_mode3d, totalbuilding_height, avgFloorHeight, numDeptPerFloor, boolean_highiterationdepartment)
placePrograms = SpacePlanning.BuildLayout.PlacePrograms(placeDepartments, create_4, minAllowedDimension, designSeedForProgram, boolean_checkaspectratio)

# group: VISUALIZE ANALYSE
visualizeDeptPrograms = SpacePlanning.SpaceAnalysis.VisualizeDeptPrograms(placePrograms, heightPolylinesRegSpaces, colorSchemeSpacePlan, boolean_colorprogramseparate, opacity)
visualizeProgramPolyLinesAndOrigin = SpacePlanning.SpaceAnalysis.VisualizeProgramPolyLinesAndOrigin(placePrograms, textPolyLinesKPULinesHeight, heightPolylinesRegSpaces, boolean_fullprogramnames)
fromStringOriginAndScale = DynamoText.Text.FromStringOriginAndScale(visualizeProgramPolyLinesAndOrigin.out2, visualizeProgramPolyLinesAndOrigin.out1, textScale)
ZAxis = Vector.ZAxis()
rotate = Geometry.Rotate(geometry=fromStringOriginAndScale, origin=visualizeProgramPolyLinesAndOrigin.out1, axis=ZAxis, degrees=textRotationAngle)
spacePlanFitnessTest = SpacePlanning.SpaceAnalysis.SpacePlanFitnessTest(placePrograms, formBuildingOutline.out6, formBuildingOutline.out1, programFitWeight, extViewWeight, travDistWeight, percKPUWeight)
spacePlanFitnessVisualize = SpacePlanning.SpaceAnalysis.SpacePlanFitnessVisualize(spacePlanFitnessTest.out0, spacePlanFitnessTest.out1, spacePlanFitnessTest.out2, spacePlanFitnessTest.out3, spacePlanFitnessTest.out4, spacePlanFitnessTest.out5, convertSiteOutlineToPolygon2d)
fromStringOriginAndScale_2 = DynamoText.Text.FromStringOriginAndScale(spacePlanFitnessVisualize.out0, spacePlanFitnessVisualize.out1, spacePlanFitnessVisualize.out4)
code_block_8 = CodeBlock { 1; }
visualizeDepartmentCirculation = SpacePlanning.SpaceAnalysis.VisualizeDepartmentCirculation(placePrograms, arg2=code_block_8)
visualizeDepartments = SpacePlanning.SpaceAnalysis.VisualizeDepartments(placeDepartments)

buildingArea = Watch(formBuildingOutline.out3)
string_siteoutline_2 = StringInput("C:\Users\subha\Documents\Visual Studio 2015\Projects\SPG DYNS\TESTEDCASESTUDIES\SFDUG CASE BED T\sampleSite.sat")
site_coverage_required = Watch(formBuildingOutline.out4)

# group: EXPORT DATA
code_block_9 = CodeBlock { "c:\cellData.xlsx"; "1"; 0; true; }
exportCellData = SpacePlanning.SpaceAnalysis.ExportCellData(placePrograms, formBuildingOutline.out6, formBuildingOutline.out7)  # frozen
writeToFile = Excel.WriteToFile(filePath=code_block_9.out0, sheetName=code_block_9.out1, startRow=code_block_9.out2, startCol=code_block_9.out2, data=exportCellData, overWrite=code_block_9.out3)
code_block_10 = CodeBlock { "c:\programData.xlsx"; "1"; 0; true; }
exportDepartmentProgramData = SpacePlanning.SpaceAnalysis.ExportDepartmentProgramData(placeDepartments)  # frozen
writeToFile_2 = Excel.WriteToFile(filePath=code_block_10.out0, sheetName=code_block_10.out1, startRow=code_block_10.out2, startCol=code_block_10.out2, data=exportDepartmentProgramData, overWrite=code_block_10.out3)

pointByPoint2d_3 = stuffer.DynamoGeometry.PointByPoint2d(code_block_4)

# group: EXPORT DWG
code_block_11 = CodeBlock { "c:\planNew.dwg"; }  # frozen
create_5 = List.Create(getSiteOutlineFromSat, visualizeProgramPolyLinesAndOrigin.out0)
flatten = Flatten(create_5)
fromGeometries = Dynamo.Translation.FileWriter.FromGeometries(code_block_11, flatten)

string_2 = StringInput("C:\Users\subha\Documents\Visual Studio 2015\Projects\SPG DYNS\TESTEDCASESTUDIES\SFDUG CASE BED T\schoolSampleProg.csv")
string_3 = StringInput("C:\Users\subha\Documents\Visual Studio 2015\Projects\SPG DYNS\TESTEDCASESTUDIES\SFDUG CASE BED T\bedTowerMKPU.csv")
deptAreaProvided = SpacePlanning.DeptData.DeptAreaProvided(placePrograms)
departmentAbbrev = SpacePlanning.DeptData.DepartmentAbbrev(placePrograms)
deptAreaNeeded = SpacePlanning.DeptData.DeptAreaNeeded(placePrograms)
sum = Math.Sum(deptAreaNeeded)
string_4 = StringInput("C:\Users\subha\Documents\Visual Studio 2015\Projects\SPG DYNS\TESTEDCASESTUDIES\SFDUG CASE BED T\bedTowerSKPU.csv")
string_5 = StringInput("C:\Users\subha\Documents\Visual Studio 2015\Projects\SPG DYNS\TESTEDCASESTUDIES\SFDUG CASE BED T\schoolSampleProgSKPU.csv")
programsInDept = SpacePlanning.DeptData.ProgramsInDept(placePrograms)
programName = SpacePlanning.ProgramData.ProgramName(programsInDept)
progPreferenceVal = SpacePlanning.ProgramData.ProgPreferenceVal(programsInDept)
programsInDept_2 = SpacePlanning.DeptData.ProgramsInDept(makeDataStack)
progPreferenceVal_2 = SpacePlanning.ProgramData.ProgPreferenceVal(programsInDept_2)
string_6 = StringInput("C:\Users\subha\Documents\Visual Studio 2015\Projects\SPG DYNS\TESTEDCASESTUDIES\NEW PROGRAMS\bedTowerShortSKPU.csv")
